# Grasshopper definition RemoSharp_Example_01.gh (Grasshopper 1.0.7)
# plug-ins: RemoSharp

# ---- group: Default Location for the new C# Component
# ↑
# By Default the Component is Generated Here
point = Point(Point(6.81305801, -31.07563732, 0))
point_2 = Point(Point(-23.26070829, -11.40862234, 0))
panel = Panel(" ")

# ---- group: websocket connection
websocket_client_start = WebsocketClientStart(Address="ws://127.0.0.1:7890/EchoAll", InitalMessage="Hello World", Reset=Button())

# ---- group: Data Sending Client / Initial C# Script
c_script = CSharpScript()  # -> out, A
# ---------- c_script: C# ----------
    Point3d[] pnts = new Point3d[5];

    pnts[0] = (Point3d) x;
    pnts[1] = HerePnt01;
    pnts[2] = (Point3d) y;
    pnts[3] = HerePnt02;
    pnts[4] = HerePnt03;
    
    Polyline pl = new Polyline(pnts);

    pl.Transform(Transform.Translation(new Vector3d(num00, num01, num02)));

    A = pl;
# ---------- end c_script ----------

# ---- group: Data Sending Client
eavesdrop = EavesDrop(InputTrigger=c_script.A, Manual_Update=False)  # -> UsingCode, Script, AdditionalCode
panel_2 = Panel("""HerePnt01
HerePnt02
HerePnt03""")
point_3 = Point([Point(-6.0184736, -14.43118949, 7.557556659), Point(-27.22450391, -1.220932096, 8.872554325), Point(-7.105522449, 13.13955494, 10.07620701)])
textpoint = TextPoint(Input_Script=eavesdrop.Script, Point_Names=panel_2, Point_Inputs=point_3)
panel_3 = Panel("""num00
num01
num02""")
merge = Merge(Data1=Slider(0, range=0..100), Data2=Slider(2, range=0..100), Data3=Slider(5, range=0..100))
textnumber = TextNumber(Input_Script=textpoint, Number_Names=panel_3, Number_Values=merge)
websocket_client_sender = WebsocketClientSender(WebsocketObjects=websocket_client_start, Message=textnumber)
panel_4 = Panel(textnumber)

# ---- group: Dara receiving client
websocket_client_receiver = WebsocketClientReceiver(WebsocketObjects=websocket_client_start, AutoUpdate=True)  # -> Message, Status
panel_5 = Panel(websocket_client_receiver.Message)
remosharp = RemoSharp(Update=Toggle(True), Default_Comp=Button(), Script=websocket_client_receiver.Message)
