# Grasshopper definition RemoSharp_Example_02.gh (Grasshopper 1.0.7)
# plug-ins: RemoSharp

c_script = CSharpScript()  # -> out, A
# ---------- c_script: C# ----------
    var pntList = new List<Point3d>();
    
    // having "count" as a keyword to be replaced by the _TextNumber_ component
    for (int i = 0; i < count; i++) {
      Point3d pnt = new Point3d(i * 2, i * 2, 0);
      
      // having "originPnt" as a keyword to be replaced by the _TextPoint_ component
      pntList.Add(pnt + originPnt);
    }

    Grasshopper.DataTree<Point3d> pntTree = new Grasshopper.DataTree<Point3d>();

    for (int i = 0 ; i < pntList.Count; i++) {
      Point3d tempPnt = pntList[i];
      var listofPnt = new List<Point3d>();
      
      // having "treeCount" as a keyword to be replaced by the _TextNumber_ component
      for (int j = 0 ; j < treeCount; j++) {
        Point3d somePnt = tempPnt + (new Vector3d(j * 2, 0, 0));
        listofPnt.Add(somePnt);
      }
      pntTree.AddRange(listofPnt, new GH_Path(i));
    }

    // Outputs of the component generated
    A = pntList[0];
    B = pntList;
    C = pntTree;
# ---------- end c_script ----------
# If the "update" input of the "RemoSharp" is set to true, a default component is created when the file is opened.
c_script_2 = CSharpScript()  # -> out, A
# ---------- c_script_2: C# ----------
    var pntList = new List<Point3d>();
    
    // having "18" as a keyword to be replaced by the _TextNumber_ component
    for (int i = 0; i < 18; i++) {
      Point3d pnt = new Point3d(i * 2, i * 2, 0);
      
      // having "new Point3d(28.9417512802199, 25.4735882323398, 0)" as a keyword to be replaced by the _TextPoint_ component
      pntList.Add(pnt + new Point3d(28.9417512802199, 25.4735882323398, 0));
    }

    Grasshopper.DataTree<Point3d> pntTree = new Grasshopper.DataTree<Point3d>();

    for (int i = 0 ; i < pntList.Count; i++) {
      Point3d tempPnt = pntList[i];
      var listofPnt = new List<Point3d>();
      
      // having "24" as a keyword to be replaced by the _TextNumber_ component
      for (int j = 0 ; j < 24; j++) {
        Point3d somePnt = tempPnt + (new Vector3d(j * 2, 0, 0));
        listofPnt.Add(somePnt);
      }
      pntTree.AddRange(listofPnt, new GH_Path(i));
    }

    // Outputs of the component generated
    A = pntList[0];
    B = pntList;
    C = pntTree;
# ---------- end c_script_2 ----------
eavesdrop = EavesDrop(InputTrigger=c_script.A, Manual_Update=False)  # -> UsingCode, Script, AdditionalCode
point = Point(Point(28.94175128, 25.47358823, 0))
textpoint = TextPoint(Input_Script=eavesdrop.Script, Point_Names="originPnt", Point_Inputs=point)
textnumber = TextNumber(Input_Script=textpoint, Number_Names="count", Number_Values=Slider(18, range=0..30))
textnumber_2 = TextNumber(Input_Script=textnumber, Number_Names="treeCount", Number_Values=Slider(24, range=0..30))

# ----
# By using the "Catch_Component" button, the closest C# component is found and is used as the new generating component.
boolean_toggle = BooleanToggle(True)
remosharp = RemoSharp(Update=boolean_toggle, Catch_Component=Button(), Default_Comp=Button(), Script=textnumber_2)

c_script_3 = CSharpScript()  # -> out, A, B, C; same code as c_script_2
boolean_toggle_2 = BooleanToggle(True)

# ----
# It is best to use the corresponding output holder for performance efficiency.
# 
# item -> item
# list -> list
# tree -> tree
output_grip_item = Output_Grip_Item(RUN=boolean_toggle_2, Output_Index=1, Output_Data_I=c_script_3.A)
output_grip_list = Output_Grip_List(RUN=boolean_toggle_2, Output_Index="2", Output_Data_L=c_script_3.B)
output_grip_tree = Output_Grip_Tree(RUN=boolean_toggle_2, Output_Index="3", Output_Data_T=c_script_3.C)

vector_xyz = VectorXYZ(XComponent=Slider(-1, range=-1..1), YComponent=0, ZComponent=0)  # -> Vector, Length
flatten_tree = FlattenTree(Tree=output_grip_tree, Path="{0}")
circle = Circle(Plane=output_grip_item, Radius=Slider(35, range=0..100))
line_sdl = LineSDL(Start=output_grip_list, Direction=vector_xyz.Vector, Length=Slider(20, range=0..100))
point_in_curve = PointInCurve(Point=flatten_tree, Curve=circle)  # -> Relationship, Point
end_points = EndPoints(Curve=line_sdl)  # -> Start, graft(End)
list_item = ListItem(List=flatten(end_points.End), Index="0", Wrap=True)
list_item_2 = ListItem(List=flatten(end_points.End), Index="-1", Wrap=True)
cull_pattern = CullPattern(List=flatten_tree, CullPattern=invert(point_in_curve.Relationship))
cull_pattern_2 = CullPattern(List=line_sdl, CullPattern=[False, True])
line = Line(StartPoint=list_item, EndPoint=list_item_2)
