# Grasshopper definition RemoSharp_Example_03 Client 01.gh (Grasshopper 1.0.7)
# plug-ins: RemoSharp

c_script = CSharpScript()  # -> out, A
# ---------- c_script: C# ----------
    Plane pl = Plane.WorldYZ;
    Point3d originPnt = point;
    pl.Origin = originPnt;

    Rectangle3d rec = new Rectangle3d(pl, point, pnt);

    Vector3d vec = new Vector3d((pnt.X - originPnt.X) / 2.0, 0, 0);
    rec.Transform(Transform.Translation(vec));

    pl.Rotate(Math.PI / 2.0 * 3, pl.ZAxis, pl.Origin);

    Curve crv = rec.ToNurbsCurve();
    Curve[] exploded = crv.DuplicateSegments();
    Curve crv00 = exploded[1];
    Curve crv01 = exploded[3];
        crv01.Reverse();

    Curve[] curveArray = {crv00,crv01};

    A = curveArray;
    B = pl;
# ---------- end c_script ----------
eavesdrop = EavesDrop(InputTrigger=c_script.A, Manual_Update=False)  # -> UsingCode, Script, AdditionalCode
pt = Point(Point(707.6692416, -567.4851362, 1098.600145))
websocket_client_start = WebsocketClientStart(Address="ws://127.0.0.1:7890/EchoAll", InitalMessage="Connection From Client 01", Reset=Button())
textpoint = TextPoint(Input_Script=eavesdrop.Script, Point_Names="point", Point_Inputs=pt)
panel = Panel(pt)
websocket_client_sender = WebsocketClientSender(WebsocketObjects=websocket_client_start, Message=textpoint)
