# Grasshopper definition RemoSharp_Example_03 Client 02.gh (Grasshopper 1.0.7)
# plug-ins: Machina, RemoSharp

pt = Point(Point(996.5990803, -915.9286721, 594.9440526))
c_script = CSharpScript(pnt=pt)  # -> out, A, B; inputs pnt: Point3d
# ---------- c_script: C# ----------
    Plane pl = Plane.WorldYZ;
    Point3d originPnt = new Point3d(707.669241586791, -579.712854431343, 1098.60014537768);
    pl.Origin = originPnt;

    Rectangle3d rec = new Rectangle3d(pl, new Point3d(707.669241586791, -579.712854431343, 1098.60014537768), pnt);

    Vector3d vec = new Vector3d((pnt.X - originPnt.X) / 2.0, 0, 0);
    rec.Transform(Transform.Translation(vec));

    pl.Rotate(Math.PI / 2.0 * 3, pl.ZAxis, pl.Origin);

    Curve crv = rec.ToNurbsCurve();
    Curve[] exploded = crv.DuplicateSegments();
    Curve crv00 = exploded[1];
    Curve crv01 = exploded[3];
        crv01.Reverse();

    Curve[] curveArray = {crv00,crv01};

    A = curveArray;
    B = pl;
# ---------- end c_script ----------
websocket_client_start = WebsocketClientStart(Address="ws://127.0.0.1:7890/EchoAll", InitalMessage="Connection From Client 02", Reset=Button())
toggle = BooleanToggle(True)
websocket_client_receiver = WebsocketClientReceiver(WebsocketObjects=websocket_client_start, AutoUpdate=True)  # -> Message, Status
number_slider = Slider(2, range=0..100)
out_gr_list = Output_Grip_List(RUN=toggle, Output_Index=1, Output_Data_L=c_script.A)
out_gr_item = Output_Grip_Item(RUN=toggle, Output_Index="2", Output_Data_I=c_script.B)
remos = RemoSharp(Update=Toggle(True), Catch_Component=False, Default_Comp=False, Script=websocket_client_receiver.Message)
item = ListItem(List=out_gr_list, Index=0, Wrap=True)  # -> Item, Item1
divide = DivideCurve(Curve=item.Item1, Count=number_slider, Kinks=False)  # -> Points, Tangents, Parameters
divide_2 = DivideCurve(Curve=item.Item, Count=number_slider, Kinks=False)  # -> Points, Tangents, Parameters
number_slider_2 = Slider(0, range=0..100)
merge = Merge(Data1=divide_2.Points, Data2=divide.Points)
pl_origin = PlaneOrigin(Base=out_gr_item, Origin=merge)
pt_2 = ConstructPoint(XCoordinate=Slider(1000, range=0..1000), YCoordinate=0, ZCoordinate=Slider(1200, range=0..10000))
pline = PolyLine(Vertices=merge, Closed=False)
c_script_2 = CSharpScript(x=Slider(0, range=0..3), y=Slider(1, range=0..3), z=Slider(0, range=0..3), u=pt_2)  # -> out, A; inputs x: Double, y: Double, z: Double, u: Plane
# ---------- c_script_2: C# ----------
    u.Rotate(Math.PI / 2.0 * x, u.XAxis, u.Origin);
    u.Rotate(Math.PI / 2.0 * y, u.YAxis, u.Origin);
    u.Rotate(Math.PI / 2.0 * z, u.ZAxis, u.Origin);
    A = u;
# ---------- end c_script_2 ----------
cull_i = CullIndex(List=pl_origin, Indices=number_slider_2, Wrap=True)
item_2 = ListItem(List=pl_origin, Index=number_slider_2, Wrap=True)
motionmode = MotionMode(MotionMode=1)
motionmode_2 = MotionMode(MotionMode=0)
motionmode_3 = MotionMode(MotionMode=1)
transformto = TransformTo(Plane=cull_i, Relative=False)  # -> flatten(Action)
transformto_2 = TransformTo(Plane=c_script_2.A, Relative=False)  # -> flatten(Action)
speedto = SpeedTo(Speed=Slider(160, range=0..200), Relative=False)  # -> flatten(Action)
transformto_3 = TransformTo(Plane=item_2, Relative=False)  # -> flatten(Action)
connect = Connect(URL="ws://127.0.0.1:6999/Bridge", Name="GH", Connect=Toggle(True))  # -> Status, Bridge
merge_2 = Merge(
    Data1=speedto,
    Data2=motionmode,
    Data3=transformto_3,
    Data4=motionmode_2,
    Data5=transformto,
    Data6=motionmode_3,
    Data7=transformto_2)
panel = Panel(merge_2)
send = Send(Bridge=connect.Bridge, Actions=merge_2, Send=Button())  # -> Sent, Instructions
