# Grasshopper definition RemoSharp_Example_04 Client 01.gh (Grasshopper 1.0.7)
# plug-ins: KUKA|prc - parametric robot control, RemoSharp

c_script = CSharpScript()  # -> out, A
# ---------- c_script: C# ----------
    Plane pl = Plane.WorldYZ;
    Point3d originPnt = point;
    pl.Origin = originPnt;

    Rectangle3d rec = new Rectangle3d(pl, point, pnt);

    Vector3d vec = new Vector3d((pnt.X - originPnt.X) / 2.0, 0, 0);
    rec.Transform(Transform.Translation(vec));

    pl.Rotate(Math.PI / 2.0 * 3, pl.ZAxis, pl.Origin);

    Curve crv = rec.ToNurbsCurve();
    Curve[] exploded = crv.DuplicateSegments();
    Curve crv00 = exploded[1];
    Curve crv01 = exploded[3];
        crv01.Reverse();

    Curve[] curveArray = {crv00,crv01};

    A = curveArray;
    B = pl;
# ---------- end c_script ----------
eavesdrop = EavesDrop(InputTrigger=c_script.A, Manual_Update=False)  # -> UsingCode, Script, AdditionalCode
websocket_client_start = WebsocketClientStart(Address="ws://127.0.0.1:7890/EchoAll", InitalMessage="Connection From Client 01", Reset=Button())  # disabled
pt = Point(Point(640.1399179, -37.31456264, 1768.528378))
textpoint = TextPoint(Input_Script=eavesdrop.Script, Point_Names="point", Point_Inputs=pt)  # disabled
concat = Concatenate(FragmentA=textpoint, FragmentB="#", FragmentC=pt, FragmentD="#", FragmentE=Button())
websocket_client_sender = WebsocketClientSender(WebsocketObjects=websocket_client_start, Message=concat)  # disabled
kr6_16_20 = KR616203Robot(infiniterot=False)
lin_move = LINearMovementKUKAPrc(TargetAsPlane=pt, extaxenabled=False, interpolation="C_DIS")
kuka_prc = KUKAPrcCORE(
    SimulationSlider=Slider(0.5, range=0..1),
    KUKAPrcCommands=lin_move,
    Robot=kr6_16_20,
    PRC_BaseExpose=False,
    PRC_SaveNameExpose=False,
    PRCsettings="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")  # -> RobotGeometry, AnalysisOutput
