# Grasshopper definition RemoSharp_Example_04 Client 03.gh (Grasshopper 1.0.7)
# plug-ins: Machina, RemoSharp, KUKA|prc - parametric robot control

c_script = CSharpScript()  # -> out, A
# ---------- c_script: C# ----------
    Plane pl = Plane.WorldYZ;
    Point3d originPnt = new Point3d(779.943272890845, -738.93874463504, 1646.05522457617);
    pl.Origin = originPnt;

    Rectangle3d rec = new Rectangle3d(pl, new Point3d(779.943272890845, -738.93874463504, 1646.05522457617), pnt);

    Vector3d vec = new Vector3d((pnt.X - originPnt.X) / 2.0, 0, 0);
    rec.Transform(Transform.Translation(vec));

    pl.Rotate(Math.PI / 2.0 * 3, pl.ZAxis, pl.Origin);

    Curve crv = rec.ToNurbsCurve();
    Curve[] exploded = crv.DuplicateSegments();
    Curve crv00 = exploded[1];
    Curve crv01 = exploded[3];
        crv01.Reverse();

    Curve[] curveArray = {crv00,crv01};

    A = curveArray;
    B = pl;
# ---------- end c_script ----------
websocket_client_start = WebsocketClientStart(Address="ws://127.0.0.1:7890/EchoAll", InitalMessage="Connection From Client 02", Reset=Button())
websocket_client_receiver = WebsocketClientReceiver(WebsocketObjects=websocket_client_start, AutoUpdate=True)  # -> Message, Status
split = TextSplit(Text=websocket_client_receiver.Message, Separators="#")
item = ListItem(List=split, Index=0, Wrap=True)  # -> Item, Item1, Item2
remos = RemoSharp(Update=Toggle(True), Catch_Component=Button(), Default_Comp=Button(), Script=item.Item)
pt = Point(Point(776.841759, -979.1457282, 939.3075933))
bool = Boolean(item.Item2)
toggle = BooleanToggle(True)
c_script_2 = CSharpScript(pnt=pt)  # -> out, A, B; inputs pnt: Point3d
# ---------- c_script_2: C# ----------
    Plane pl = Plane.WorldYZ;
    Point3d originPnt = new Point3d(779.943272890845, -542.153593216677, 1366.69428183573);
    pl.Origin = originPnt;

    Rectangle3d rec = new Rectangle3d(pl, new Point3d(779.943272890845, -542.153593216677, 1366.69428183573), pnt);

    Vector3d vec = new Vector3d((pnt.X - originPnt.X) / 2.0, 0, 0);
    rec.Transform(Transform.Translation(vec));

    pl.Rotate(Math.PI / 2.0 * 3, pl.ZAxis, pl.Origin);

    Curve crv = rec.ToNurbsCurve();
    Curve[] exploded = crv.DuplicateSegments();
    Curve crv00 = exploded[1];
    Curve crv01 = exploded[3];
        crv01.Reverse();

    Curve[] curveArray = {crv00,crv01};

    A = curveArray;
    B = pl;
# ---------- end c_script_2 ----------
out_gr_list = Output_Grip_List(RUN=toggle, Output_Index=1, Output_Data_L=c_script_2.A)
out_gr_item = Output_Grip_Item(RUN=toggle, Output_Index="2", Output_Data_I=c_script_2.B)
c_script_3 = CSharpScript(x=Slider(0, range=0..3), y=Slider(1, range=0..3), z=Slider(0, range=0..3), u=item.Item1)  # -> out, A; inputs x: Double, y: Double, z: Double, u: Plane
# ---------- c_script_3: C# ----------
    u.Rotate(Math.PI / 2.0 * x, u.XAxis, u.Origin);
    u.Rotate(Math.PI / 2.0 * y, u.YAxis, u.Origin);
    u.Rotate(Math.PI / 2.0 * z, u.ZAxis, u.Origin);
    A = u;
# ---------- end c_script_3 ----------
number_slider = Slider(0, range=0..100)
number_slider_2 = Slider(0, range=0..100)
pt_2 = Point(Point(782.9721039, -823.8240605, 1039.596667))
pl_origin = PlaneOrigin(Base=out_gr_item, Origin=pt_2)
panel = Panel(bool)
cull_i = CullIndex(Indices=number_slider, Wrap=True)
item_2 = ListItem(Index=number_slider, Wrap=True)
axesto = AxesTo(
    A1=number_slider_2,
    A2=number_slider_2,
    A3=number_slider_2,
    A4=number_slider_2,
    A5="0",
    A6=number_slider_2,
    Relative=False)  # -> flatten(Action)
number_slider_3 = Slider(0.145, range=0..1)  # disabled
c_script_4 = CSharpScript(client01=Button(), action01=pl_origin, client02=bool, action02=c_script_3.A)  # -> out, A, S; inputs client01: Boolean, action01: Plane, client02: Boolean, action02: Plane
# ---------- c_script_4: C# ----------
    if (client01) {
      A = action01;
      S = client01;
    }
    else if (client02) {
      A = action02;
      S = client02;
    }
    else {
      A = null;
      S = false;
    }
# ---------- end c_script_4 ----------
rec_2pt = Rectangle2Pt(Plane=out_gr_item, PointA=out_gr_item, PointB=pl_origin, Radius=0)  # -> Rectangle, Length
motionmode = MotionMode(MotionMode=1)
motionmode_2 = MotionMode(MotionMode=0)
motionmode_3 = MotionMode(MotionMode=1)
lin_move = LINearMovementKUKAPrc(extaxenabled=False, interpolation="C_DIS")  # disabled
kr6_16_20 = KR616203Robot(infiniterot=False)  # disabled
transformto = TransformTo(Plane=cull_i, Relative=False)  # -> flatten(Action)
speedto = SpeedTo(Speed=Slider(160, range=0..200), Relative=False)  # -> flatten(Action)
transformto_2 = TransformTo(Plane=item_2, Relative=False)  # -> flatten(Action)
connect = Connect(URL="ws://127.0.0.1:6999/Bridge", Name="GH", Connect=Toggle(True))  # -> Status, Bridge
transformto_3 = TransformTo(Plane=c_script_4.A, Relative=False)  # -> flatten(Action)
merge = Merge(Data1=speedto, Data2=motionmode, Data3=transformto_2, Data4=motionmode_2, Data5=transformto, Data6=motionmode_3)
kuka_prc = KUKAPrcCORE(
    SimulationSlider=number_slider_3,
    KUKAPrcCommands=lin_move,
    Robot=kr6_16_20,
    PRC_BaseExpose=False,
    PRC_SaveNameExpose=False,
    PRCsettings="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")  # -> RobotGeometry, AnalysisOutput; disabled
panel_2 = Panel(transformto_3)
send = Send(Bridge=connect.Bridge, Actions=transformto_3, Send=c_script_4.S)  # -> Sent, Instructions
